# Dynamo custom node NumberRoomByGrid.dyf (Dynamo 0.9.2.4472)
# category: Sasaki
# update room number by grid crosspoint

Rooms = Input()
location = Custom[Element.Location](element=Rooms)  # Returns the location of an element as an XYZ (or if it's line-based the start and end point of the line), along with some booleans to help filtering the results. Use this for some element types (e.g. walls or lines) that do not work with the built-in Get Family Instance Location node.
filterByBoolMask = List.FilterByBoolMask(list=Rooms, mask=location.hasLocation)
RoomsWithoutLocation = Output(filterByBoolMask.out)
code_block = CodeBlock { "-"; }
LevelNames = Input()
LevelNumbers = Input()
createDictionary = Lists.Dictionary.CreateDictionary(LevelNames, LevelNumbers)
code_block_2 = CodeBlock { "Level"; }
getParameterValueByName = Element.GetParameterValueByName(element=filterByBoolMask.in, parameterName=code_block_2)
getValueFromDictionary = Lists.Dictionary.GetValueFromDictionary(createDictionary, getParameterValueByName)
code_block_3 = CodeBlock { ""; }
categories = Categories("Grids")
all_elements_of_category = ElementsOfCategory(categories)
name = Family.Name(all_elements_of_category)
Prefix = Input()
startsWith = String.StartsWith(str=name, searchFor=Prefix)
filterByBoolMask_2 = List.FilterByBoolMask(list=all_elements_of_category, mask=startsWith)
curve = Grid.Curve(filterByBoolMask_2.in)
type = Object.Type(curve)
code_block_4 = CodeBlock(x=type) { x == "Autodesk.DesignScript.Geometry.Line"; }
filterByBoolMask_3 = List.FilterByBoolMask(list=filterByBoolMask_2.in, mask=code_block_4)
curve_2 = Grid.Curve(filterByBoolMask_3.in)
direction = Line.Direction(curve_2)
code_block_5 = CodeBlock(v=direction) { v.X == 0 || v.Y == 0; }
filterByBoolMask_4 = List.FilterByBoolMask(list=filterByBoolMask_3.in, mask=code_block_5)
curve_3 = Grid.Curve(filterByBoolMask_4.in)
direction_2 = Line.Direction(curve_3)
X = Vector.X(direction_2)
code_block_6 = CodeBlock(x=X) { x==0; }
filterByBoolMask_5 = List.FilterByBoolMask(list=filterByBoolMask_4.in, mask=code_block_6)
vertical_grid_lines = Watch(filterByBoolMask_5.out)
filterByBoolMask_6 = List.FilterByBoolMask(list=curve_3, mask=code_block_6)
vertical_grid_lines_2 = Watch(filterByBoolMask_6.out)
startPoint = Curve.StartPoint(vertical_grid_lines_2)
Y = Point.Y(startPoint)
intersect = Geometry.Intersect(geometry=filterByBoolMask_6.in, other=filterByBoolMask_6.out, lacing=CrossProduct)
flatten = Flatten(intersect)
location_2 = Custom[Element.Location](element=filterByBoolMask.in)
get_closest_points = Python(IN[0]=flatten, IN[1]=location_2.points)
# ---------- get_closest_points.python (23 lines) ----------
import clr
clr.AddReference('ProtoGeometry')
from Autodesk.DesignScript.Geometry import *
#The inputs to this node will be stored as a list in the IN variables.
targetList = IN[0]
startList = IN[1]
ans = []

for startPoint in startList:
	closestPoint = targetList[0]
	closestDist = -1
	for targetPoint in targetList:
		dist = pow(abs(targetPoint.X - startPoint.X), 2) + \
				   pow(abs(targetPoint.Y - startPoint.Y), 2) + \
				   pow(abs(targetPoint.Z - startPoint.Z), 2)
		if closestDist == -1 or closestDist > dist:
			closestDist = dist
			closestPoint = targetPoint
			
	ans.append(closestPoint)

#Assign your output to the OUT variable.
OUT = ans
# ----------------------------------------
flatten_2 = Flatten(get_closest_points)
Y_2 = Point.Y(flatten_2)
eq = Y == Y_2  # lacing=CrossProduct
transpose = List.Transpose(eq)
code_block_7 = CodeBlock { {true}; }
if_equal_return_index = Custom[If Equal Return Index](listA=code_block_7)  # If element in list A is equal to an element in list B then return index from list B.
map = List.Map(list=transpose, f_x=if_equal_return_index)
getItemAtIndex = List.GetItemAtIndex(list=vertical_grid_lines, index=map)
name_2 = Family.Name(getItemAtIndex)
horizontal_grid_lines = Watch(filterByBoolMask_5.in)
horizontal_grid_lines_2 = Watch(filterByBoolMask_6.in)
startPoint_2 = Curve.StartPoint(horizontal_grid_lines_2)
X_2 = Point.X(startPoint_2)
X_3 = Point.X(flatten_2)
eq_2 = X_2 == X_3  # lacing=CrossProduct
transpose_2 = List.Transpose(eq_2)
code_block_8 = CodeBlock { {true}; }
if_equal_return_index_2 = Custom[If Equal Return Index](listA=code_block_8)
map_2 = List.Map(list=transpose_2, f_x=if_equal_return_index_2)
getItemAtIndex_2 = List.GetItemAtIndex(list=horizontal_grid_lines, index=map_2)
name_3 = Family.Name(getItemAtIndex_2)
create = List.Create(name_2, name_3)
flatten_3 = Flatten()
map_3 = List.Map(list=create, f_x=flatten_3)
transpose_3 = List.Transpose(map_3)
length = String.Length(Prefix)
length_2 = String.Length(transpose_3)
code_block_9 = CodeBlock(x=length_2, y=length) { x - y; }
substring = String.Substring(str=transpose_3, startIndex=length, length=code_block_9)
join = String.Join(code_block_3, substring)
create_2 = List.Create(getValueFromDictionary, join)
flatten_4 = Flatten()
map_4 = List.Map(list=create_2, f_x=flatten_4)
transpose_4 = List.Transpose(map_4)
join_2 = String.Join(code_block, transpose_4)
RoomNumbers = Output(join_2)
vertical_grid_line_count = List.Count(vertical_grid_lines_2)
horizontal_grid_line_count = List.Count(horizontal_grid_lines_2)
code_block_10 = CodeBlock { "Number"; }
flatten_5 = Flatten(join_2)
setParameterByName = Element.SetParameterByName(element=filterByBoolMask.in, parameterName=code_block_10, value=flatten_5)
get_closest_n_points = Custom[Get Closest N points]()  # Find the closes set of points in 2 lists
