# Dynamo graph NumberRoomByGrid.dyn (Dynamo 0.9.2.4472)

# group: prefix
# note: Prefix: grid name prefix
# default value: ""
# optional: have a special grid for room numbering, e.g. prefix by _
code_block = CodeBlock { ""; }

# group: rooms
# note: Rooms: rooms to be updated
# optional: apply filter to the input room list
categories = Categories("Rooms")
all_elements_of_category = ElementsOfCategory(categories)

# group: level numbers & level names
code_block_2 = CodeBlock()
# ---------- code_block_2.designscript (11 lines) ----------
{"1",
 "2",
 "3",
 "4",
 "5",
 "L",
 "P",
 "R",
 "T",
 "A",
 "E"};
# ----------------------------------------
# note: LevelNames: all level names
# LevelNumbers: the shortname to present the level name in the room number
code_block_3 = CodeBlock()
# ---------- code_block_3.designscript (11 lines) ----------
{"Level 1",
 "Level 2",
 "Level 3",
 "Level 4",
 "Level 5",
 "Lobby Level 1",
 "Plaza Level 1",
 "ROOF",
 "T.O.PARAPET",
 "AVE GRADE PLANE",
 "Egree South"};
# ----------------------------------------

numberRoomByGrid = Custom[NumberRoomByGrid](Prefix=code_block, Rooms=all_elements_of_category, LevelNumbers=code_block_2, LevelNames=code_block_3)  # update room number by grid crosspoint

# group: rooms without location
# note: RoomsWithoutLocation: room(s) without location information, e.g. doesn't delete from the room schedule
# optional: click the green ID to view the room in Revit
watch = Watch(numberRoomByGrid.RoomsWithoutLocation)

# group: room numbers
# note: RoomNumbers: successfully set room numbers
watch_2 = Watch(numberRoomByGrid.RoomNumbers)
